# Grasshopper definition Kinect&Udp_Communication.gh (Grasshopper 0.9.76)
# plug-ins: Kangaroo Components, gHowl

panel = Panel("""3
4
6
8
16
32
96""")
number_slider = Slider(2105, range=0..2500)
xz = XZPlane(Origin=Point(0, 0, 0))
pi = Pi(Factor=Slider(0.5, range=0..1))
addition = Addition(A=number_slider, B=Slider(10000, range=0..10000))
item = ListItem(List=panel, Index=Slider(1, range=0..10), Wrap=True)
rotate = Rotate(Geometry=xz, Angle=pi, Plane=xz)  # -> Geometry, Transform
xy = XYPlane(Origin=Point(0, 0, 0))
polygon = Polygon(Plane=rotate.Geometry, Radius=number_slider, Segments=item, FilletRadius=0)  # -> Polygon, Length
X = UnitX(Factor=addition)
move = Move(Geometry=xy, Motion=X)  # -> Geometry, Transform
line = LineSDL(Start=xy, Direction=Vector(0, 0, 1), Length=Slider(1144, range=0..10000))
cir = Circle(Plane=move.Geometry, Radius=addition)
divide = DivideCurve(Curve=polygon.Polygon, Count=Slider(32, range=0..100), Kinks=False)  # -> Points, Tangents, Parameters
eval = EvaluateLength(Curve=cir, Length=Slider(0.501, range=0..1), Normalized=True)  # -> Point, Tangent, Parameter
pline = PolyLine(Vertices=divide.Points, Closed=Toggle(True))
multiplication = Multiplication(A=eval.Tangent, B=Slider(14583, range=0..100000))
clx = CurveLine(Curve=pline, Line=line)  # -> Points, Params, Count
vdis = VectorDisplay(Anchor=eval.Point, Vector=multiplication)
devec = DeconstructVector(Vector=multiplication)  # -> XComponent, YComponent, ZComponent
# Observer
pdecon = Deconstruct(Point=eval.Point)  # -> XComponent, YComponent, ZComponent
item_2 = ListItem(List=clx.Points, Index=0, Wrap=True)

timer = Timer(TimerInterval=50, Target=counter)
counter = Counter(Reset=Toggle(False))
division = Division(A=counter, B=Slider(3561, range=0..10000))
pi_2 = Pi(Factor=1)
multiplication_2 = Multiplication(A=division, B=pi_2)
panel_2 = Panel(division)

addition_2 = Addition(A=pdecon.XComponent, B=devec.XComponent)
addition_3 = Addition(A=pdecon.YComponent, B=devec.YComponent)
# LookAt
addition_4 = Addition(A=pdecon.ZComponent, B=devec.ZComponent)
panel_3 = Panel("55")
arrpolar = PolarArray(Geometry=pline, Plane=move.Geometry, Count=Slider(46, range=0..100), Angle=6.283185307)  # -> Geometry, Transform
rotate_2 = Rotate(Geometry=arrpolar.Geometry, Angle=multiplication_2, Plane=move.Geometry)  # -> Geometry, Transform
cp = ControlPoints(Curve=rotate_2.Geometry)  # -> Points, Weights, Knots
pdecon_2 = Deconstruct(Point=cp.Points)  # -> XComponent, YComponent, flatten(ZComponent)
mesh = Mesh(<mesh referenced from the Rhino model>)
sort = SortList(Keys=pdecon_2.ZComponent)  # -> Keys, ValuesA
panel_4 = Panel(pdecon_2.ZComponent)
demesh = DeconstructMesh(Mesh=mesh)  # -> Vertices, Faces, Colours, Normals
item_3 = ListItem(List=sort.Keys, Index=0, Wrap=True)
abs = Absolute(Value=item_3)
geo = Geometry(<brep referenced from the Rhino model>)
Z = UnitZ(Factor=abs)
debrep = DeconstructBrep(Brep=geo)  # -> Faces, Edges, Vertices
geo_2 = Geometry(<brep referenced from the Rhino model>)
move_2 = Move(Geometry=rotate_2.Geometry, Motion=Z)  # -> Geometry, Transform
mesh_2 = MeshBrep(
    Brep=debrep.Faces,
    Settings={GridMaxCount=0, GridMinCount=16, JaggedSeams=False, MaxEdgeLength=0, MinEdgeLength=0.0001, MinTolerance=0, Refine=True, RefineAngle=0, RelativeTolerance=0.65, SimplePlanes=True, Tolerance=0})
sdivide = DivideSurface(Surface=geo_2, UCount=Slider(47, range=0..100), VCount=Slider(17, range=0..100))  # -> Points, Normals, Parameters
cp_2 = ControlPoints(Curve=move_2.Geometry)  # -> Points, Weights, Knots
quaddiv = QuadDivide(Mesh=mesh_2, Divisions=Slider(10, range=0..100))
geo_3 = Geometry(simplify(cp_2.Points))
demesh_2 = DeconstructMesh(Mesh=quaddiv)  # -> Vertices, Faces, Colours, Normals
pdecon_3 = Deconstruct(Point=demesh_2.Vertices)  # -> flatten(XComponent), flatten(YComponent), flatten(ZComponent)
entwine = Entwine(Branch00=pdecon_3.XComponent, Branch01=pdecon_3.YComponent, Branch02=pdecon_3.ZComponent, FlattenInputs=True)  # -> flatten(Result)
panel_5 = Panel(entwine)
ip_address_of_the_receiving_machine = Panel("192.168.0.101")
port_to_send_to = Panel("10000")
sending_pattern = Panel("0")
udp_owl = UDPSender(Port=port_to_send_to, Pattern=sending_pattern, Data=panel_5)
panel_6 = Panel(udp_owl)
